vi "FrontPanel.gvi"   [LabVIEW NXG 3.1.0]
panel controls:
  "Pattern Size": f64[2] = [512, 512]
  "Display position": f64[] = [0, 0]
  "Show display": bool
  "Spot positions": f64[][] = [[10, 10, 10]]
  "Stop": bool
  "err Input": error
panel indicators:
  "Pattern": f64[][]
  "err Output": error
uses:
  otslm::initOtslm.mli::initOtslm
  otslm::utils::ScreenDevice::Construct.gvi
  PrismsAndLenses::GenerateImages.gvi
  otslm::tools::combine.gvi
  otslm::tools::finalize.gvi
  otslm::utils::ScreenDevice::Close.gvi
  otslm::utils::ScreenDevice::Show.gvi
  otslm::utils::ScreenDevice::Delete.gvi
diagram:
  w1 = $"Pattern Size"
  call "initOtslm"(error in=$"err Input") -> (error out=w2)
  call "Construct.gvi"(varname="ScreenDevice", target_size=w1, target_offset=$"Display position", pattern_type="phase", device_id=0, error in=w2, prescaled=TRUE) -> (error out=w3)
  s1 = w3  # shift register
  while {
    call "GenerateImages.gvi"(sz=w1, positions=$"Spot positions", error in=s1) -> (Image array=w4, error out=w5)
    call "combine.gvi"(inputs=w4, error in=w5) -> (im=w6, error out=w7)
    call "finalize.gvi"(input=w6, error in=w7) -> (im=w8, error out=w9)
    $Pattern <- w8
    case ($"Show display") {
      frame False, Default {
        call "Close.gvi"(varname="ScreenDevice", error in=w9) -> (error out=w10)
      }
      frame True {
        call "Show.gvi"(varname="ScreenDevice", pattern=w8, error in=w9) -> (error out=w10)
      }
    }
    next s1 = w10
    stop if $Stop
  }
  call "Delete.gvi"(varname="ScreenDevice", error in=s1) -> (error out=w11)
  $"err Output" <- w11
