vi "GenerateImages.gvi"   [LabVIEW NXG 3.1.0]
inputs:
  "sz": f64[2]
  "positions": f64[][]
  "error in": error
outputs:
  "error out": error
  "Image array": f64[][][]
panel controls:
  "page index": i32
panel indicators:
  "Intensity Graph": f64[][]
uses:
  otslm::simple::linear.gvi
  otslm::simple::spherical.gvi
diagram:
  s1 = $"error in"  # shift register
  for {
    w1 = each element of $positions
    Array Index(array=w1) -> (out0[0]=w3, out1[1]=w4, out2[2]=w5)
    Build Array(w3, w4) -> w6
    Divide(x=[512, 512], y=w6) -> w7
    call "linear.gvi"(sz=$sz, spacing=w7, error in=s1) -> (im=w8, error out=w9)
    Array Max And Min(array=$sz) -> (max value=w10)
    Divide(x=w10, y=2) -> w11
    Build Array(w11, w11) -> w12
    Square Root(x=2) -> w13
    Multiply(w13, w11) -> w14
    call "spherical.gvi"(sz=$sz, radius=w14, centre=w12, scale=w5, error in=w9) -> (im=w15, error out=w16)
    Add(w8, w15) -> w17
    append w17 to w2
    next s1 = w16
  }
  Array Index(array=w2) -> (out0[$"page index", _, _]=w18)
  $"Intensity Graph" <- w18
  $"Image array" <- w2
  $"error out" <- s1
