vi "linear.gvi"   [LabVIEW NXG 3.1.0]
inputs:
  "error in": error
  "sz": f64[]
  "spacing": f64[]
  "centre": f64[]
outputs:
  "error out": error
  "im": f64[][]
panel indicators:
  "Intensity Graph": f64[][]
uses:
  NI::G Core::Error::Multiplex Errors.gvi
  otslm::simple::linear.mli::otslm.simple.linear
  otslm::tools::finalize.gvi
diagram:
  Array Size(array=$centre) -> (size(s)=w1)
  case (w1) {
    frame 0 {
      Divide(x=$sz, y=2) -> w2
      w3 = $"error in"
    }
    frame 2 {
      w2 = $centre
      w3 = $"error in"
    }
    frame Default {
      w4 = error {"status"=TRUE, "code"=1, "source"="linear.gvi: invalid value for centre.  Must be 2 element array of DBL."}  # Error
      call "Multiplex Errors.gvi"(error in 1=$"error in", error in 2=w4) -> (error out=w3)
      w2 = [0, 0]
    }
  }
  call "otslm.simple.linear"(sz=$sz, spacing=$spacing, centre_str="centre", centre=w2, error in=w3) -> (im=w5, error out=w6)
  $im <- w5
  call "finalize.gvi"(input=w5, error in=w6) -> (im=w7)
  $"Intensity Graph" <- w7
  $"error out" <- w6
