vi "spherical.gvi"   [LabVIEW NXG 3.1.0]
inputs:
  "error in": error
  "sz": f64[], required
  "radius": f64, required
  "centre": f64[]
  "scale": f64, required
  "type": string
outputs:
  "error out": error
  "im": f64[][]
panel indicators:
  "Intensity Graph": f64[][]
uses:
  NI::G Core::Error::Multiplex Errors.gvi
  otslm::simple::spherical.mli::otslm.simple.spherical
  otslm::tools::finalize.gvi
diagram:
  Array Size(array=$centre) -> (size(s)=w1)
  case (w1) {
    frame 0 {
      Divide(x=$sz, y=2) -> w2
      w3 = $"error in"
    }
    frame 2 {
      w2 = $centre
      w3 = $"error in"
    }
    frame Default {
      w4 = error {"status"=TRUE, "code"=1, "source"="spherical.gvi: invalid value for centre.  Must be 2 element array of DBL."}  # Error
      call "Multiplex Errors.gvi"(error in 1=$"error in", error in 2=w4) -> (error out=w3)
      w2 = [0, 0]
    }
  }
  Is Empty String Or Path(string/path=$type) -> w5
  case (w5) {
    frame False, Default {
      w6 = $type
    }
    frame True {
      w6 = "2d"
    }
  }
  call "otslm.simple.spherical"(sz=$sz, radius=$radius, centre_str="centre", centre=w2, type_str="type", type=w6, scale_str="scale", scale=$scale, error in=w3) -> (im=w7, error out=w8)
  $im <- w7
  call "finalize.gvi"(input=w7, error in=w8) -> (im=w9)
  $"Intensity Graph" <- w9
  $"error out" <- w8
