vi "Construct.gvi"   [LabVIEW NXG 3.1.0]
inputs:
  "error in": error
  "varname": string, required
  "pattern_type": string
  "target_offset": f64[], required
  "target_size": f64[], required
  "device_id": f64
  "prescaled": bool
outputs:
  "error out": error
uses:
  otslm::utils::ScreenDevice::ScreenDevice.mli::construct
diagram:
  Is Equal To 0(x=$device_id) -> w1
  case (w1) {
    frame False, Default {
      w2 = $device_id
    }
    frame True {
      w2 = 1
    }
  }
  call "construct"(varname=$varname, classname="otslm.utils.ScreenDevice", methodname="", device_id=w2, target_size_str="target_size", target_size=$target_size, target_offset_str="target_offset", target_offset=$target_offset, pattern_type_str="pattern_type", pattern_type=$pattern_type, prescaled_str="prescaledPatterns", prescaled=$prescaled, error in=$"error in") -> (error out=w3)
  $"error out" <- w3
